% Simulink data dictionary VehicleConfig.sldd

VehicleFixed = Simulink.ConfigSet(StartTime="0", StopTime="2474", Solver="ode4", ProdHWDeviceType="Intel->x86-64 (Windows64)", SystemTargetFile="grt.tlc", TargetLang="C")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
VehicleVariable = Simulink.ConfigSet(StartTime="0", StopTime="2474", RelTol="1e-3", Solver="ode23tb", ProdHWDeviceType="Intel->x86-64 (Windows64)", SystemTargetFile="grt.tlc", TargetLang="C")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

CAN_MESSAGE_BUS = Simulink.Bus()
  Extended: uint8
  Length: uint8
  Remote: uint8
  Error: uint8
  ID: uint32
  Timestamp: double
  Data: uint8[8]